# Grasshopper definition SurfacePatternTool.gh (Grasshopper 1.0.8)

solidin = Brep(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)
fi = Slider(22, range=0..33)
bi = Slider(4, range=0..5)
cols = Slider(12, range=2..40)
shape = Slider(0, range=0..2)
nsides = Slider(6, range=3..12)
rad = Slider(2.6, range=0.1..8)
fdep = Slider(2.8, range=0..10)
bdep = Slider(2.8, range=0..10)
offu = Slider(0, range=-1..1)
offv = Slider(0, range=-1..1)
fall = Slider(0, range=0..1)
edge = Slider(1, range=0..10)
hexq = BooleanToggle(True)
cut = BooleanToggle(True)
macpro = BooleanToggle(True)
thick = Slider(0, range=0..20)
conform = BooleanToggle(False)
patterntool = GhPythonScript(
    S=solidin,
    fi=fi,
    bi=bi,
    cols=cols,
    shape=shape,
    nsides=nsides,
    rad=rad,
    fdep=fdep,
    bdep=bdep,
    offU=offu,
    offV=offv,
    hexq=hexq,
    fall=fall,
    edge=edge,
    cut=cut,
    macpro=macpro,
    thick=thick,
    conform=conform)  # -> out, G, C; inputs S: Brep, fi: Int32, bi: Int32, cols: Int32, shape: Int32, nsides: Int32, rad: Double, fdep: Double, bdep: Double, offU: Double, offV: Double, hexq: Boolean, fall: Double, edge: Double, cut: Boolean, macpro: Boolean, thick: Double, conform: Boolean
# ---------- patterntool: Python ----------
import Rhino
import Rhino.Geometry as rg
import System, math

RD = Rhino.RhinoDoc.ActiveDoc
tol = RD.ModelAbsoluteTolerance if RD else 0.001
if tol <= 0: tol = 0.001
SQ3 = math.sqrt(3.0)
from Rhino.Geometry.Intersect import Intersection as ISX

def coerce_brep(x):
    if x is None: return None
    if isinstance(x, rg.Brep): return x
    if isinstance(x, rg.Surface): return x.ToBrep()
    v = getattr(x,'Value',None)
    if isinstance(v, rg.Brep): return v
    if isinstance(v, rg.Surface): return v.ToBrep()
    return None
def num(x,d):
    try: return float(x)
    except: return d
def ival(x,d):
    try: return int(round(float(x)))
    except: return d
def tobool(x):
    if x is None: return False
    v = getattr(x,'Value',None)
    if v is not None: return bool(v)
    return bool(x)

G = []; C = []
brep = coerce_brep(S)
if brep is not None:
    cols_ = max(1, ival(cols,12)); rad_ = max(0.001, num(rad,2.0))
    fdep_ = num(fdep,2.0); bdep_ = num(bdep,2.0)
    offU_ = num(offU,0.5); offV_ = num(offV,0.5)
    fall_ = num(fall,0.0); edge_ = num(edge,0.0)
    shape_ = ival(shape,0); nsides_ = max(3, ival(nsides,6))
    do_hex = tobool(hexq); do_cut = tobool(cut)
    macpro_ = tobool(macpro); conform_ = tobool(conform); thick_in = num(thick,0.0)
    nf = brep.Faces.Count
    fi_ = min(max(0, ival(fi,0)), nf-1); bi_ = min(max(0, ival(bi,0)), nf-1)
    diag = brep.GetBoundingBox(True).Diagonal.Length

    def onrm(face,u,v):
        n = face.NormalAt(u,v)
        if face.OrientationIsReversed: n = -n
        return n
    def measure_t(face,u,v):
        p = face.PointAt(u,v); n = onrm(face,u,v)
        if not n.IsValid: return None
        n.Unitize()
        ln = rg.Line(p - n*(tol*10.0), p - n*diag).ToNurbsCurve()
        rc = ISX.CurveBrep(ln, brep, tol)
        pts = rc[2] if rc and len(rc) >= 3 else None
        if not pts: return None
        ds = sorted([p.DistanceTo(q) for q in pts if p.DistanceTo(q) > tol*10.0])
        return ds[0] if ds else None
    def fedges(fidx):
        cs = []
        for lp in brep.Faces[fidx].Loops:
            c = lp.To3dCurve()
            if c: cs.append(c)
        j = rg.Curve.JoinCurves(cs, tol)
        return list(j) if j else cs
    def grid_uv(face, uoff, voff, du_ov):
        ud = face.Domain(0); vd = face.Domain(1)
        u0,u1 = ud.T0,ud.T1; v0,v1 = vd.T0,vd.T1
        if du_ov and du_ov > 1e-9:
            n_u = max(1, int(round((u1-u0)/du_ov)))
        else:
            n_u = cols_
        du = (u1-u0)/float(n_u)
        rowH = du*(SQ3/2.0) if do_hex else du
        if rowH <= 1e-12: rowH = 1.0
        nrows = max(1, int(math.floor((v1-v0)/rowH + 0.5)))
        out = []
        for jj in range(nrows+1):
            vv = v0 + (jj+voff)*rowH
            if vv < v0-1e-9 or vv > v1+1e-9: continue
            shift = du*0.5 if (do_hex and (jj%2==1)) else 0.0
            for ii in range(n_u+1):
                uu = u0 + (ii+uoff)*du + shift
                if uu < u0-1e-9 or uu > u1+1e-9: continue
                out.append((uu,vv))
        return out
    def cull(face, uvs, edges):
        if edge_ <= 0 or not edges: return uvs
        keep = []
        for (uu,vv) in uvs:
            p = face.PointAt(uu,vv); ok = True
            for c in edges:
                hit = c.ClosestPoint(p, edge_)
                if hit[0]: ok = False; break
            if ok: keep.append((uu,vv))
        return keep
    def make_shape(shp, p, n, r, depth):
        if shp == 0:
            return rg.Sphere(p + n*(r-depth), r).ToBrep()
        elif shp == 1:
            cir = rg.Circle(rg.Plane(p + n*0.05, n), r)
            return rg.Cylinder(cir, -(depth+0.1)).ToBrep(True, True)
        else:
            pl = rg.Plane(p + n*0.05, n); poly = rg.Polyline()
            for k in range(nsides_):
                a = 2*math.pi*k/nsides_
                poly.Add(pl.PointAt(r*math.cos(a), r*math.sin(a)))
            poly.Add(poly[0])
            ex = rg.Extrusion.CreateExtrusion(poly.ToPolylineCurve(), n*(-(depth+0.1)))
            if ex:
                b = ex.ToBrep()
                if b and not b.IsSolid:
                    cb = b.CapPlanarHoles(tol)
                    if cb: b = cb
                return b
        return None

    # nominal thickness for Mac Pro grid spacing/offset
    t_nom = 1.0
    if macpro_ or conform_:
        if thick_in > 0:
            t_nom = thick_in
        else:
            f = brep.Faces[fi_]
            tm = measure_t(f, f.Domain(0).Mid, f.Domain(1).Mid)
            t_nom = tm if tm else 1.0
    if macpro_:
        eps = tol*10.0
        FF = brep.Faces[fi_]
        amp2 = rg.AreaMassProperties.Compute(FF.ToBrep())
        c0 = amp2.Centroid if amp2 else FF.PointAt(FF.Domain(0).Mid, FF.Domain(1).Mid)
        okc, uu0, vv0 = FF.ClosestPoint(c0)
        Navg = onrm(FF, uu0, vv0); Navg.Unitize()
        plane = rg.Plane(c0, Navg)
        s = 2.0*t_nom; rowH = s*(SQ3/2.0)
        try:
            fbb = FF.ToBrep().GetBoundingBox(plane)
            umn, umx, vmn, vmx = fbb.Min.X, fbb.Max.X, fbb.Min.Y, fbb.Max.Y
        except:
            h = diag*0.6; umn=-h; umx=h; vmn=-h; vmx=h
        marg = s
        def hit_front(wp):
            ln = rg.Line(wp + Navg*(diag*0.5), wp - Navg*(diag*0.5)).ToNurbsCurve()
            rc = ISX.CurveBrep(ln, brep, tol)
            pp = rc[2] if rc and len(rc) >= 3 else None
            if not pp: return None
            best=None; bp=-1e18
            for q in pp:
                pr = (q - c0)*Navg
                if pr > bp: bp=pr; best=q
            return best
        def hit_back(Pf):
            okp, uu, vv = FF.ClosestPoint(Pf)
            nl = onrm(FF, uu, vv); nl.Unitize()
            ln = rg.Line(Pf - nl*eps, Pf - nl*diag).ToNurbsCurve()
            rc = ISX.CurveBrep(ln, brep, tol)
            pp = rc[2] if rc and len(rc) >= 3 else None
            if not pp: return None, None
            near=None; nd=1e18
            for q in pp:
                d = Pf.DistanceTo(q)
                if d > eps and d < nd: nd=d; near=q
            return near, nd
        def lattice(ox, oy):
            out=[]
            jmn=int(math.floor((vmn-marg-oy)/rowH)); jmx=int(math.ceil((vmx+marg-oy)/rowH))
            imn=int(math.floor((umn-marg-ox)/s)); imx=int(math.ceil((umx+marg-ox)/s))
            for jj in range(jmn, jmx+1):
                yy=oy+jj*rowH; shh = s*0.5 if (jj%2!=0) else 0.0
                for ii in range(imn, imx+1):
                    out.append((ox+ii*s+shh, yy))
            return out
        front_cut=[]
        for (xx,yy) in lattice(0.0,0.0):
            Pf = hit_front(plane.PointAt(xx,yy))
            if Pf is None: continue
            ti = t_nom
            if conform_:
                bkp, tt = hit_back(Pf)
                if tt: ti = tt
            front_cut.append(rg.Sphere(Pf, ti*SQ3/2.0).ToBrep())
        back_cut=[]
        for (xx,yy) in lattice(offU_*s, offV_*rowH):
            Pf = hit_front(plane.PointAt(xx,yy))
            if Pf is None: continue
            Bp, tt = hit_back(Pf)
            if Bp is None: continue
            ti = tt if conform_ else t_nom
            back_cut.append(rg.Sphere(Bp, ti*SQ3/2.0).ToBrep())
        C = front_cut + back_cut
    else:
        fuv = cull(brep.Faces[fi_], grid_uv(brep.Faces[fi_], 0.0, 0.0, du_ov), fedges(fi_))
        buv = cull(brep.Faces[bi_], grid_uv(brep.Faces[bi_], offU_, offV_, du_ov), fedges(bi_))
        C = cutters_for(fi_, fuv, fdep_) + cutters_for(bi_, buv, bdep_)
    if do_cut and C:
        cur = brep; B = 25
        for i in range(0, len(C), B):
            chunk = C[i:i+B]
            rr = rg.Brep.CreateBooleanDifference([cur], chunk, tol)
            if rr and len(rr) >= 1:
                if len(rr) == 1:
                    cur = rr[0]
                else:
                    best = None; ba = -1.0
                    for b in rr:
                        try: a = b.GetArea()
                        except: a = 0.0
                        if a > ba: ba = a; best = b
                    cur = best if best else cur
        G = [cur]
    else:
        G = [brep]
try:
    if do_cut: C = []
except: pass
# ---------- end patterntool ----------
